# Grasshopper definition export_meshes_to_objs.gh (Grasshopper 1.0.7)
# plug-ins: LunchBox

mesh = Mesh([<mesh referenced from the Rhino model> x32])
mesh_2 = Mesh(simplify(graft(mesh)))
panel = Panel("D:\code_ws\pb_ws\compas_fab_pychoreo\tests\data\itj_rfl_obstacles")
tree_statistics = TreeStatistics(Tree=mesh_2)  # -> Paths, Length, Count
list_item = ListItem(List=tree_statistics.Paths, Index=Slider(53, range=0..53), Wrap=True)
tree_branch = TreeBranch(Tree=mesh_2, Path=list_item, MaintainPaths=True)
deconstruct_path = DeconstructPath(Branch=tree_statistics.Paths)  # -> simplify(Indices)
concatenate = Concatenate(Fragment_A="itj_rfl_obstacles", B="_", A=deconstruct_path, Fragment_B=".obj")
panel_2 = Panel(concatenate)
object_save = ObjectSave(
    BakeToggle=Toggle(False),
    FileDirectory=panel,
    FileName=concatenate,
    GeometryObjects=mesh_2,
    Layer="GH_Export",
    ObjectName="GH_Obj",
    ObjectColor=RGB(255, 255, 255),
    LayerColor=RGB(255, 255, 255))
