# Grasshopper definition collision_checker_conf.ghx (Grasshopper 1.0.7)

rhino_doc_dir = RhinoDocDir()  # -> rhino_doc_dir
# ---------- rhino_doc_dir: Python ----------
import scriptcontext as sc
from os import path

rhino_doc_dir = path.abspath(path.dirname(sc.doc.Path))
# ---------- end rhino_doc_dir ----------
panel = Panel("C:\Users\harry\Dropbox (MIT)\code_ws_dropbox\itj_ws\integral_timber_joints\external\compas_fab_pychoreo\tests\data")  # disabled
panel_2 = Panel("C:\Users\harry\Dropbox (MIT)\code_ws_dropbox\itj_ws\integral_timber_joints\external\compas_fab_pychoreo\tests\data")
panel_3 = Panel("C:\Users\harry\Dropbox (MIT)\code_ws_dropbox\itj_ws\integral_timber_joints\src\integral_timber_joints\planning\data")
ghpython_script = GhPythonScript(current_path=rhino_doc_dir)  # -> out, pkg_path
# ---------- ghpython_script: Python ----------
import os

pkg_path = os.path.abspath(os.path.join(current_path, '..', '..', 'data', 'robots'))
# ---------- end ghpython_script ----------
panel_4 = Panel(ghpython_script.pkg_path)
number_slider = Slider(0.6, range=0..1)
degrees = Degrees(Radians=number_slider)
boolean_toggle = BooleanToggle(True)
reload = Button()

# ----
# Robot
load = Button()
ghpython_script_2 = PythonScript(load=load, pkg_path=panel_4, pkg_name="abb_irb4600_40_255", urdf_file="abb_irb4600_40_255.urdf")  # -> out, robot
# ---------- ghpython_script_2: Python ----------
from scriptcontext import sticky as st
import os
import compas

from compas.robots import RobotModel
from compas.robots import GithubPackageMeshLoader
from compas.robots import LocalPackageMeshLoader
from compas_fab.robots import Robot
from compas_fab.robots import RobotSemantics
from compas_fab.ghpython import RobotArtist

# Robot meshes are usually in meters
# Set a high percision to prevent parsing errors
# and configure Rhino itself in meters
compas.PRECISION = '12f'

# Store robot in component-based key
robot_key = 'robot_{}'.format(str(ghenv.Component.InstanceGuid))

if robot_key not in st:
    st[robot_key] = None

if load:
    # Load robot (try other repo/package combinations, e.g. 'abb_irb120_support')
#    repo    = 'ros-industrial/abb'
#    package = 'abb_irb6600_support'
#    branch  = 'kinetic-devel'
#    github = GithubPackageMeshLoader(repo, package, branch)
#    model = RobotModel.from_urdf_file(github.load_urdf('irb6640.urdf'))
#    model.load_geometry(github)

#    # Create robot model from URDF
    loader = LocalPackageMeshLoader(pkg_path, pkg_name)
    
    # Create robot model from URDF
    model = RobotModel.from_urdf_string(loader.load_urdf(urdf_file).read())
    model.load_geometry(loader)

    artist = RobotArtist(model)
    robot = Robot(model, artist)
    st[robot_key] = robot

robot = st[robot_key]
# ---------- end ghpython_script_2 ----------
robot = Data(ghpython_script_2.robot)

panel_5 = Panel("TC3_Igus")  # disabled
panel_6 = Panel("g1.urdf")  # disabled
panel_7 = Panel("TC3_Igus.urdf")  # disabled
panel_8 = Panel("c1.urdf")  # disabled
panel_9 = Panel("g1")  # disabled
panel_10 = Panel("c1")  # disabled
division = Division(A=degrees, B="3")
py = PythonScript(reload=reload)
# ---------- py: Python ----------
if reload:
    from compas_ghpython import unload_modules
    unload_modules('compas')
# ---------- end py ----------
division_2 = Division(A=number_slider, B="3")
ghpython_script_3 = PythonScript(pkg_path=panel_2, pkg_name="s1", urdf_file="s1.urdf")  # -> out, visual, collision
# ---------- ghpython_script_3: Python ----------
from scriptcontext import sticky as st
import os
import compas

from compas.robots import RobotModel
from compas.robots import GithubPackageMeshLoader
from compas.robots import LocalPackageMeshLoader
from compas_fab.robots import Robot
from compas_fab.robots import RobotSemantics
from compas_fab.ghpython import RobotArtist

# Robot meshes are usually in meters
# Set a high percision to prevent parsing errors
# and configure Rhino itself in meters
compas.PRECISION = '12f'


#    # Create robot model from URDF
loader = LocalPackageMeshLoader(pkg_path, pkg_name)

# Create robot model from URDF
model = RobotModel.from_urdf_string(loader.load_urdf(urdf_file).read())
model.load_geometry(loader)

artist = RobotArtist(model)
robot = Robot(model, artist)

visual = robot.artist.draw_visual()
collision = robot.artist.draw_collision()
# ---------- end ghpython_script_3 ----------
ghpython_script_4 = PythonScript(pkg_path=panel_2, pkg_name=panel_10, urdf_file=panel_8)  # -> out, visual, collision; disabled; same code as ghpython_script_3
ghpython_script_5 = PythonScript(pkg_path=panel, pkg_name=panel_9, urdf_file=panel_6)  # -> out, visual, collision; disabled; same code as ghpython_script_3
ghpython_script_6 = PythonScript(pkg_path=panel_2, pkg_name=panel_5, urdf_file=panel_7)  # -> out, visual, collision; disabled; same code as ghpython_script_3
panel_11 = Panel(division_2)
series = Series(Start=Slider(0, range=0..100), Step=division, Count="3")
list_item = ListItem(List=series, Index=Slider(2, range=0..10), Wrap=False)
panel_12 = Panel(ghpython_script_5.visual)  # disabled
panel_13 = Panel(ghpython_script_5.collision)  # disabled
panel_14 = Panel(ghpython_script_4.collision)  # disabled
panel_15 = Panel(ghpython_script_4.visual)  # disabled
panel_16 = Panel(ghpython_script_6.visual)  # disabled
panel_17 = Panel(ghpython_script_6.collision)  # disabled
panel_18 = Panel(ghpython_script_3.visual)
panel_19 = Panel(ghpython_script_3.collision)
ghpython_script_7 = GhPythonScript()  # -> out, a
# ---------- ghpython_script_7: Python ----------
a = (-0.22933341324429715, -0.16013458841355072, 0.16156061274225791, -0.04047458211667868, 0.2826972759319871, 1.3717482426703684)
# ---------- end ghpython_script_7 ----------
ghpython_script_8 = GhPythonScript()  # -> out, a
# ---------- ghpython_script_8: Python ----------
a = \
    (-0.45866682648859436, -0.32026917682710143, 0.32312122548451583, -0.08094916423335738, 0.5653945518639742, 1.504312716424763)
# ---------- end ghpython_script_8 ----------
mesh = Mesh(ghpython_script_6.visual)  # disabled
mesh_2 = Mesh(ghpython_script_3.visual)
degrees_2 = Degrees(Radians=ghpython_script_8.a)

# ---- group: forward kinematics
# Configuration
a3 = Slider(20, range=-360..360)
a2 = Slider(0, range=-360..360)
a4 = Slider(0, range=-360..360)
a5 = Slider(0, range=-360..360)
a1 = Slider(0, range=-360..360)
a6 = Slider(71, range=-360..360)
forward_kinematics = PythonScript(robot=robot, joint_values=degrees_2)  # -> out, configuration; inputs joint_values: list
# ---------- forward_kinematics: Python ----------
import math
from compas_fab.robots import Configuration

if robot:
    joint_names = robot.get_configurable_joint_names()
    configuration = Configuration.from_revolute_values([math.radians(a) for a in joint_values])
    
    print [math.radians(a) for a in joint_values]
# ---------- end forward_kinematics ----------

# ----
panel_20 = Panel(forward_kinematics.out)
merge = Merge(Data1=a1, Data2=a2, Data3=a3, Data4=a4, Data5=a5, Data6=a6)
configurations_at_pickup = Data(forward_kinematics.configuration)

# ---- group: beam
mesh_3 = Mesh(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)  # disabled

# ---- group: env obstacles
brep = Brep([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])

# ----
scale = Scale(Geometry=mesh_2, Center=Point(0, 0, 0), Factor="1e-3")  # -> Geometry, Transform
scale_2 = Scale(Geometry=mesh_3, Center=Point(0, 0, 0), Factor="1e-3")  # -> Geometry, Transform
scale_3 = Scale(Geometry=mesh, Center=Point(0, 0, 0), Factor="1e-3")  # -> Geometry, Transform
mesh_4 = Mesh(graft([<mesh referenced from the Rhino model> x4]))
unit_z = UnitZ(Factor="0.063")

# ----
# Visualisation
value_list = ValueList({"forward_kinematics": 0, "inverse_kinematics": 1, "calculated_path": 2}, selected="forward_kinematics")
stream_filter = StreamFilter(Gate=value_list, Stream0=configurations_at_pickup)
show_end_effector_frame = BooleanToggle(True)
show_base_frame = BooleanToggle(True)
show_collision = BooleanToggle(True)
show_frames = BooleanToggle(True)
show_visual = BooleanToggle(False)
visualize = PythonScript(
    robot=robot,
    configuration=stream_filter,
    show_visual=show_visual,
    show_collision=show_collision,
    show_frames=show_frames,
    show_base_frame=show_base_frame,
    show_end_effector_frame=show_end_effector_frame)  # -> out, visual, collision, frames, ee_frame, base_frame
# ---------- visualize: Python ----------
"""Visualizes a robot.
    Inputs:
        robot: The robot
        configuration: :class:`compas_fab.robots.Configuration`
            The robot's full configuration to display.
        show_visual: bool
           Whether or not to show the robot's visual meshes.
        show_collision: bool
           Whether or not to show the robot's collision meshes.
        show_frames: bool
           Whether or not to show the robot's joint frames.
        show_base_frame: bool
           Whether or not to show the robot's base frame.
        show_end_effector_frame: bool
            Whether or not to show the robot's end-effector frame.
    Output:
        visual: The robot's visual meshes.
        collision: The robot's collision meshes.
        frames: The robot's joint frames.
        base_frame: The robot's base frame.
        ee_frame: The robot's end-effector frame.
"""
from __future__ import print_function
#print (robot.group_names)
if robot and configuration:
    group = group or None
    robot.update(configuration, group, visual=show_visual, collision=show_collision)
    print(robot.get_end_effector_link_name(group))
    
    if show_visual:
        visual = robot.artist.draw_visual()

    if show_collision:
        collision = robot.artist.draw_collision()

    if show_frames:
        axes = robot.transformed_axes(configuration, group)
        frames = robot.transformed_frames(configuration, group)

    if show_base_frame:
        frames = robot.transformed_frames(configuration, group)
        base_frame = frames[0]

    if show_end_effector_frame:
        ee_frame = robot.forward_kinematics(configuration, group)
        print("End-effector", ee_frame)
# ---------- end visualize ----------
geometry = Geometry(visualize.collision)
geometry_2 = Geometry(visualize.visual)
draw = GhPythonScript(frames=[visualize.frames, visualize.ee_frame, visualize.base_frame], scale=Slider(0.1, range=0..1))  # -> P, V, C, W, flatten(planes); inputs frames: list
# ---------- draw: Python ----------
from System.Drawing import Color
from compas_ghpython import draw_frame

red = Color.FromArgb(255, 0, 0)
green = Color.FromArgb(0, 255, 0)
blue = Color.FromArgb(0, 0, 255)

P = []
V = []
C = []
planes = []

scale = float(scale)

for frame in frames:
    if not frame:
        continue
    plane = draw_frame(frame)
    P += [plane.Origin] * 3
    V.append(plane.XAxis * scale)
    V.append(plane.YAxis * scale)
    V.append(plane.ZAxis * scale)
    C += [red, green, blue]
    planes.append(plane)

W = 3
# ---------- end draw ----------
vector_display_ex = VectorDisplayEx(Point=draw.P, Vector=draw.V, Colour=draw.C, Width=draw.W)

list_item_2 = ListItem(List=visualize.frames, Index=Slider(14, range=0..43), Wrap=True)
ghpython_script_9 = GhPythonScript(x=list_item_2)  # -> out, a
# ---------- ghpython_script_9: Python ----------
from compas_ghpython import draw_frame

a = draw_frame(x)
# ---------- end ghpython_script_9 ----------
move = Move(Geometry=scale.Geometry, Motion=unit_z)  # -> Geometry, Transform
plane = Plane(ghpython_script_9.a)
scale_4 = Scale(Geometry=plane, Center=Point(0, 0, 0), Factor="1")  # -> Geometry, Transform
orient = Orient(Geometry=scale.Geometry, Source=PlaneXY(0, 0, 0), Target=scale_4.Geometry)  # -> Geometry, Transform
mesh_5 = Mesh(orient.Geometry)
collision_one_many = CollisionOneMany(Collider=mesh_4, Obstacles=mesh_5)  # -> Collision, Index
panel_21 = Panel(collision_one_many.Collision)
orient_2 = Orient(Geometry=move.Geometry, Source=PlaneXY(0, 0, 0), Target=scale_4.Geometry)  # -> Geometry, Transform; disabled
orient_3 = Orient(Geometry=scale_2.Geometry, Source=PlaneXY(0, 0, 0), Target=scale_4.Geometry)  # -> Geometry, Transform; disabled
orient_4 = Orient(Geometry=scale_3.Geometry, Source=PlaneXY(0, 0, 0), Target=scale_4.Geometry)  # -> Geometry, Transform; disabled
scale_5 = Scale(Geometry=[geometry_2, geometry], Center=Point(0, 0, 0), Factor="1")  # -> Geometry, Transform
